# Grasshopper definition construction-kit.gh (Grasshopper 0.9.80)

ls = Slider(5, range=0..20)
notch_corner_radius = Slider(0.36, range=0..1)
circle_radius = Slider(3, range=1..5)
l_width_height = Slider(5, range=1..8)
# INPUTS
notch_width = Slider(0.26363, range=0..1)
notches = Slider(4, range=0..10)
circles = Slider(5, range=0..20)

# ----
# Circle - make and position a single notch
_2 = Number(2)
notch_length = Division(A=circle_radius, B=_2)
number = Number(-2)
notch_y_move = Subtraction(A=circle_radius, B=notch_length)
notch_x_move = Division(A=notch_width, B=number)
notch = Rectangle(Plane=PlaneXY(0, 0, 0), XSize=notch_width, YSize=notch_length, Radius=0)  # -> Rectangle, Length
notch_move = VectorXYZ(XComponent=notch_x_move, YComponent=notch_y_move, ZComponent=0)  # -> Vector, Length
move_notch = Move(Geometry=notch.Rectangle, Motion=notch_move.Vector)  # -> Geometry, Transform

# ----
# L - basic setup
_2_2 = Number(2)
large_square = Rectangle(Plane=PlaneXY(0, 0, 0), XSize=l_width_height, YSize=l_width_height, Radius=0)  # -> Rectangle, Length
large_square_width_2 = Division(A=l_width_height, B=_2_2)
small_square_vector = VectorXYZ(XComponent=large_square_width_2, YComponent=large_square_width_2, ZComponent=0)  # -> Vector, Length
small_square = Rectangle(Plane=PlaneXY(0, 0, 0), XSize=large_square_width_2, YSize=large_square_width_2, Radius=0)  # -> Rectangle, Length
move_small_square = Move(Geometry=small_square.Rectangle, Motion=small_square_vector.Vector)  # -> Geometry, Transform
region_difference = RegionDifference(CurvesA=large_square.Rectangle, CurvesB=move_small_square.Geometry)

# ----
# Array notches, trim, and add fillet
polar_array = PolarArray(Geometry=move_notch.Geometry, Plane=PlaneXY(0, 0, 0), Count=notches, Angle=6.283185307)  # -> Geometry, Transform
circle = Circle(Plane=PlaneXY(0, 0, 0), Radius=circle_radius)
region_difference_2 = RegionDifference(CurvesA=circle, CurvesB=polar_array.Geometry)
fillet = Fillet(Curve=region_difference_2, Radius=notch_corner_radius)

# ----
# L - add and position notches
_4 = Number(4)
notch_length_2 = Division(A=l_width_height, B=_4)
subtraction = Subtraction(A=l_width_height, B=notch_length_2)
addition = Addition(A=notch_length_2, B=notch_x_move)
l_notch_1 = Rectangle(Plane=PlaneXY(0, 0, 0), XSize=notch_width, YSize=notch_length_2, Radius=0)  # -> Rectangle, Length
l_notch_2 = Rectangle(Plane=PlaneXY(0, 0, 0), XSize=notch_length_2, YSize=notch_width, Radius=0)  # -> Rectangle, Length
l_notch_1_vector = VectorXYZ(XComponent=addition, YComponent=subtraction, ZComponent=0)  # -> Vector, Length
l_notch_2_vector = VectorXYZ(XComponent=subtraction, YComponent=addition, ZComponent=0)  # -> Vector, Length
move = Move(Geometry=l_notch_2.Rectangle, Motion=l_notch_2_vector.Vector)  # -> Geometry, Transform
move_2 = Move(Geometry=l_notch_1.Rectangle, Motion=l_notch_1_vector.Vector)  # -> Geometry, Transform

# ----
# Make multiple circles
number_2 = Number(-1)
multiplication = Multiplication(A=circle_radius, B=number_2)
vector_xyz = VectorXYZ(XComponent=0, YComponent=multiplication, ZComponent=0)  # -> Vector, Length
move_3 = Move(Geometry=fillet, Motion=vector_xyz.Vector)  # -> Geometry, Transform
linear_array = LinearArray(Geometry=move_3.Geometry, Direction=Vector(10, 0, 0), Count=circles)  # -> Geometry, Transform

# ----
# L - trim and add fillet
region_difference_3 = RegionDifference(CurvesA=region_difference, CurvesB=move.Geometry)
region_difference_4 = RegionDifference(CurvesA=region_difference_3, CurvesB=move_2.Geometry)
fillet_2 = Fillet(Curve=region_difference_4, Radius=notch_corner_radius)

linear_array_2 = LinearArray(Geometry=fillet_2, Direction=Vector(10, 0, 0), Count=ls)  # -> Geometry, Transform
